# Dynamo graph CANTIERE optimizer (Revit 2021).dyn "CANTIERE-optimizer2021" (Dynamo 2.5.0.7460)
# packages: LunchBox for Dynamo 2018.7.6, Refinery Toolkit 1.1.0, Speckle for Dynamo 1.7.0, GenerativeDesign 1.1.0

# note: Outputs
# Dark green indicates Outputs of the optimization.

# group: CANTIERE optimizer
# note: REQUIRED DYNAMO PACKAGES
# LunchBox for Dynamo (version 2018.7.6)
# Refinery Toolkit (version 1.1.0)
# Speckle for Dynamo (version 1.7.0)
# Refinery (version 0.62.2)
# note: DYNAMO VERSION
# 2.1
# note: DYNAMO PROJECT
# CANTIERE optimizer.dyn
# note: ASSOCIATED FILE(S)
# Revit IS.dyn
# SketchUp IS.dyn
# note: AUTHOR(S) / CREATION DATE
# Lorenzo Beltrani / July 2020
# note: DESCRIPTION
# This graph generates the main objects to support the activities on the construction site: the crane, the lay-down and material storage areas, the temporary facilities and the site paths. The performance of the generated geometry is evaluated by checking multiple parameters.
# The graph uses Generative Design to optimize the construction site layout geometry in terms of time, cost, safety and quality.
# note: ADDITIONAL COMMENTS
# The legend of the visualization is placed at the end of the graph, where the colors are assigned to the geometry.

# group: User inputs
input_source = IntegerSlider(2, range=1..3 step 1)
cell_size_mm = DoubleSlider(2000, range=1000..10000 step 1000)
# note: Inputs / Variables
# Light green indicates Inputs and Variables that can be altered per project and must be set accordingly before running the script. The user inputs are only set by the user, while the input variables are changed within their ranges by Generative Design during the optimization
budget_mln_dkk = DoubleSlider(99, range=1..362 step 1)

# group: Import Data
# note: Initialization
# Blue indicates the initialization of the process, where the inputs are taken and any data needed for the optimization is calculated.
revit_is = Receiver(DocumentName="CANTIERE-optimizer2021", OldStreamId="Fsx4XkouO", myReceiver="dVBNS8NAEE20TePHWQQ95OCxbJq0VhEC2qpQPCi2FW9lk0zpkulu2I9q/eledJd46MWBeTvsvH3zZj3f87wfG+50cbxnYTStoagQxkJCN3oDqZjgWUKuSY/0utHYoDYSMg5GS4rd6MXkyIon2M5EBTzjBrHtBM93dMhffVezMTLgOrCEg7kC+bCmDDsjqmAuMZxqCXQ9KVuvAiFsqJPysClm2xp832/5/smudNN0D5x7l8G+hTO0Tf4lSA5ojXJ2uxLaDSNMBy1LuFhpXaubOC5hQ1agNKNENbrkQ8hKxbRmQdsZfVSfg/dKmOf2t/2tf6a7nTsbigYWCy90PtxN0LFwerlM8jQtl0nah8HVEJJ+WebFcBiEjnK/5XQtjn4B", RestApi="https://dev.hestia.speckle.works/api", Email="lorenzo.beltrani@hotmail.it", Server="Speckle Hestia Dev Server", StreamId="Fsx4XkouO", Transmitting=false, Paused=false, StreamTextBoxEnabled=true)  # unwired: ID
list_create = List.Create(item0=revit_is.Building_Footprint, item1=revit_is.Workspace, item2=revit_is.Site_Objects, item3=revit_is.Access_to_Site, item4=revit_is.Number_of_Storeys)
# note: Generation
# Orange indicates the part of the graph where all the objects are generated and placed on the site.
# note: Evaluation
# Grey indicates the part of the graph where the parameters used for the scoring system are calculated by checking the generated geometry.
sketchup_is = Receiver(DocumentName="CANTIERE-optimizer2021", OldStreamId="1vY-BiTHZ", myReceiver="dVBNTwIxEN0qu6wfZ2OiBw4esWzVVTAhUdBE4sXIYqIXUtgh2zC0m7aLwZ/uRdusBy5OMq+TzuubNw1IEAQ/Lvzp43DHwWBcwnyJMFQa2q030EYo2We0SxOatFvDCm2loS+hsppju/VSzVDMn2GTqSXIvqwQQy94uqVD/+r7UgxRgLSRI+xNDOjHFRfYHHADE43x2Grgq1HeeFUIcU0d5ft1kW1KIIQ0CDnalq6b/oF37zPadXCCrim/FJ0BOqNS3BXK+mFU2KjhCGeFtaW57XRyWNMCjBWcmlqXfiq9NB1eiij0Rtn6/XwgsqeP8Nv91j/T/c7NNccKptMg9j78TdR0cJwuWG/OkguWX7PF1c0i7V2mHJJeFHvKw0bylTr4BQ==", RestApi="https://dev.hestia.speckle.works/api", Email="lorenzo.beltrani@hotmail.it", Server="Speckle Hestia Dev Server", StreamId="1vY-BiTHZ", Transmitting=false, Paused=false, StreamTextBoxEnabled=true)  # unwired: ID
list_create_2 = List.Create(item0=sketchup_is.Building_Footprint, item1=sketchup_is.Workspace, item2=sketchup_is.Site_Objects, item3=sketchup_is.Access_to_Site, item4=sketchup_is.Number_of_Storeys)
list_create_3 = List.Create()  # unwired: item0, item1, item2, item3, item4
python_script = Python(IN[0]=input_source, IN[1]=list_create, IN[2]=list_create_2, IN[3]=list_create_3)
# ---------- python_script.python (19 lines) ----------
# Load the Python Standard and DesignScript Libraries
import sys
import clr
clr.AddReference('ProtoGeometry')
from Autodesk.DesignScript.Geometry import *

# The inputs to this node will be stored as a list in the IN variables.
bool = IN[0]
setup = IN[1]
grass = IN[2]
sket = IN[3]

# Place your code below this line
if bool == 1:
	OUT = setup
elif bool == 2:
	OUT = grass
else:
	OUT = sket
# ----------------------------------------
code_block = CodeBlock { 0; 1; 2; 3; 4; }
getItemAtIndex = List.GetItemAtIndex(list=python_script, index=code_block.out1)
remember = Data.Remember(getItemAtIndex)
byPatch = Surface.ByPatch(closedCurve=remember)
getItemAtIndex_2 = List.GetItemAtIndex(list=python_script, index=code_block.out0)
remember_2 = Data.Remember(getItemAtIndex_2)
byPatch_2 = Surface.ByPatch(closedCurve=remember_2)
getItemAtIndex_3 = List.GetItemAtIndex(list=python_script, index=code_block.out2)
remember_3 = Data.Remember(getItemAtIndex_3)
byPatch_3 = Surface.ByPatch(closedCurve=remember_3)
getItemAtIndex_4 = List.GetItemAtIndex(list=python_script, index=code_block.out4)
remember_4 = Data.Remember(getItemAtIndex_4)
getItemAtIndex_5 = List.GetItemAtIndex(list=python_script, index=code_block.out3)
remember_5 = Data.Remember(getItemAtIndex_5)
# note: Visualization
# Purple indicates the part of the graph where the 3D shape of the objects is created and the colors assigned.
speckle_receiver = Receiver(DocumentName="CANTIERE-optimizer2021", RestApi="https://dev.hestia.speckle.works/api", Email="lorenzo.beltrani@hotmail.it", Server="Speckle Hestia Dev Server", Transmitting=false, Paused=false, StreamTextBoxEnabled=true)  # unwired: ID

# group: Set site boundary
code_block_2 = CodeBlock(x=cell_size_mm) { x*2; }
offset = Curve.Offset(curve=remember, distance=code_block_2)
list_create_4 = List.Create(item0=offset, item1=remember)
byLoft = Surface.ByLoft(crossSections=list_create_4)

# group: Create grid
boundingBox = Geometry.BoundingBox(geometry=byPatch)
maxPoint = BoundingBox.MaxPoint(boundingBox=boundingBox)
X = Point.X(point=maxPoint)
minPoint = BoundingBox.MinPoint(boundingBox=boundingBox)
X_2 = Point.X(point=minPoint)
sub = X - X_2
div = sub / cell_size_mm
Y = Point.Y(point=maxPoint)
Y_2 = Point.Y(point=minPoint)
sub_2 = Y - Y_2
div_2 = sub_2 / cell_size_mm
panelQuad = Geometry.Panel.PanelQuad(srf=byPatch, u=div, v=div_2)
doesIntersect = Geometry.DoesIntersect(geometry=panelQuad.Panels, other=byPatch)
filterByBoolMask = List.FilterByBoolMask(list=panelQuad.Panels, mask=doesIntersect)
thicken = Surface.Thicken(surface=byLoft)
subtractFrom = Surface.SubtractFrom(surface=filterByBoolMask.in, trimmingEntity=thicken)
flatten = List.Flatten(list=subtractFrom)
area = Surface.Area(surface=flatten)
code_block_3 = CodeBlock(x=cell_size_mm) { y=x*x; y-y/20; }
gt = area > code_block_3.out1
filterByBoolMask_2 = List.FilterByBoolMask(list=flatten, mask=gt)
perimeterCurves = Surface.PerimeterCurves(surface=filterByBoolMask_2.in)

# group: Building and site objects
list_create_5 = List.Create(item0=byPatch_2, item1=byPatch_3)
removeNulls = Lists.Manage.RemoveNulls(Data=list_create_5)
byJoinedSurfaces = PolySurface.ByJoinedSurfaces(surfaces=removeNulls.Cleaned)
doesIntersect_2 = Geometry.DoesIntersect(geometry=filterByBoolMask_2.in, other=byJoinedSurfaces)
filterByBoolMask_3 = List.FilterByBoolMask(list=filterByBoolMask_2.in, mask=doesIntersect_2)

# group: Input variables
number_of_cranes = IntegerSlider(1, range=1..2 step 1)  # graph input
crane_position = IntegerSlider(149, range=0..1000 step 1)  # graph input
crane_size = IntegerSlider(40000, range=20000..60000 step 10000)  # graph input
number_of_container_layers = IntegerSlider(2, range=1..3 step 1)  # graph input
percentage_of_covered_area = IntegerSlider(20, range=0..50 step 10)  # graph input
material_area_shape = IntegerSlider(837, range=0..1000 step 1)  # graph input
material_position = IntegerSlider(300, range=0..1000 step 1)  # graph input
temporary_facilities_position = IntegerSlider(285, range=0..1000 step 1)  # graph input
temporary_facilities_shape = IntegerSlider(509, range=0..1000 step 1)  # graph input
site_path_points = IntegerSlider(555, range=0..1000 step 1)  # graph input

# group: Equipment generation
code_block_4 = CodeBlock { 0.5; }
pointAtParameter = Surface.PointAtParameter(surface=filterByBoolMask_3.out, u=code_block_4, v=code_block_4)
number = DoubleInput(0)
count = List.Count(list=pointAtParameter)
code_block_5 = CodeBlock(x=count) { x-1; }
randomNumbers = Lists.Sequence.RandomNumbers(Min=number, Max=code_block_5, Number=number_of_cranes, Seed=crane_position)
round = Math.Round(number=randomNumbers)
code_block_6 = CodeBlock(x=crane_size) { x/7; }
byWidthLength = Rectangle.ByWidthLength(width=code_block_6, length=code_block_6)
byPatch_4 = Surface.ByPatch(closedCurve=byWidthLength)
remember_6 = Data.Remember(filterByBoolMask_3.in)
remember_7 = Data.Remember(byLoft)
list_create_6 = List.Create(item0=remember_6, item1=remember_7)
flatten_2 = List.Flatten(list=list_create_6)
byJoinedSurfaces_2 = PolySurface.ByJoinedSurfaces(surfaces=flatten_2)
python_script_2 = Python(IN[0]=pointAtParameter, IN[1]=round, IN[2]=byPatch_4, IN[3]=byJoinedSurfaces_2)
# ---------- python_script_2.python (56 lines) ----------
# Load the Python Standard and DesignScript Libraries
import sys
import clr
clr.AddReference('ProtoGeometry')
from Autodesk.DesignScript.Geometry import *

# The inputs to this node will be stored as a list in the IN variables.
locations = IN[0]
index = IN[1]
geometry = IN[2]
existent = IN[3]

# Place your code below this line
x1 = 0
x2 = 0

bool1 = True
while bool1 == True:
	point1 = locations[int(index[0])]
	crane1 = Geometry.Translate(geometry,point1.X,point1.Y,point1.Z)
	bool1 = Geometry.DoesIntersect(crane1,existent)
	if index[0] == len(locations)-1:
		index[0]=0
	else:
		index[0]+=1
	x1+=1
	if x1 == len(locations):
		bool1 = False

if len(index)>1:
	bool2 = True
	boolex2 = True
	boolcr2 = True
	while bool2 == True:
		point2 = locations[int(index[1])]
		crane2 = Geometry.Translate(geometry,point2.X,point2.Y,point2.Z)
		boolex2 = Geometry.DoesIntersect(crane1,crane2)
		boolcr2 = Geometry.DoesIntersect(crane2,existent)
		if boolex2 == False and boolcr2 == False:
			bool2 = False
		if index[1] == len(locations)-1:
			index[1]=0
		else:
			index[1]+=1
		x2+=1
		if x2 == len(locations):
			bool1 = False

# Assign your output to the OUT variable.
if x1 == len(locations) or x2 == len(locations):
	OUT = None
else:
	if len(index) == 1:
		OUT = crane1,index[0]-1
	else:
		OUT = [[crane1,crane2],[index[0]-1,index[1]-1]]
# ----------------------------------------
firstItem = List.FirstItem(list=python_script_2)
byJoinedSurfaces_3 = PolySurface.ByJoinedSurfaces(surfaces=firstItem)
doesIntersect_3 = Geometry.DoesIntersect(geometry=byJoinedSurfaces_3, other=filterByBoolMask_3.out)
filterByBoolMask_4 = List.FilterByBoolMask(list=filterByBoolMask_3.out, mask=doesIntersect_3)
lastItem = List.LastItem(list=python_script_2)

# group: Sizing
# note: 0.04 is total number of workers divided by the total number of built square meters in Bosnia Herzegovina in 2017
# 2.45 is the average number of projects in which a worker works yearly (estimating duration by cost / see paper)
# 3 is the layers on which the containers are stackable
# All the other values are taken from the rule of thumb of the book: Construction Site Planning
area_2 = Surface.Area(surface=byPatch_2)
mul = area_2 * remember_4
code_block_7 = CodeBlock(budget=budget_mln_dkk, area=mul, layers=number_of_container_layers)
# ---------- code_block_7.designscript (8 lines) ----------
cost=budget*1000000*0.15;
laydown=28.9*cost;
warehouse=2.8*cost;
TotalMaterialaArea=laydown+warehouse;
workers=area*0.04/(2.45*1000000);
offices=0.7*7.5*workers*1000000/layers;
toilets=0.1*3*workers*1000000/layers;
TotalTemporaryFacilities=offices+toilets;
# ----------------------------------------

# group: Material lay-down and storage areas generation
code_block_8 = CodeBlock { 0.5; }
pointAtParameter_2 = Surface.PointAtParameter(surface=filterByBoolMask_4.out, u=code_block_8, v=code_block_8)
number_2 = DoubleInput(0)
count_2 = List.Count(list=pointAtParameter_2)
code_block_9 = CodeBlock(x=count_2) { x-1; }
code_block_10 = CodeBlock { 0.5; 1; 2; }
randomNumbers_2 = Lists.Sequence.RandomNumbers(Min=code_block_10.out0, Max=code_block_10.out1, Number=code_block_10.out2, Seed=material_area_shape)
python_script_3 = Python(IN[0]=code_block_7.TotalMaterialaArea, IN[1]=percentage_of_covered_area, IN[2]=randomNumbers_2)
# ---------- python_script_3.python (51 lines) ----------
# Load the Python Standard and DesignScript Libraries
import sys
import clr
clr.AddReference('ProtoGeometry')
from Autodesk.DesignScript.Geometry import *
import math

# The inputs to this node will be stored as a list in the IN variables.
size = IN[0]
percent = IN[1]
rapport = IN[2]

# Place your code below this line
rectangles = []

if percent <= 20:

	side1 = math.sqrt(size)*rapport[0]
	side2 = size/side1
	
	even = math.ceil(rapport[0]*100)%2

	if even == 0:
		rectangles.append(Rectangle.ByWidthLength(side1,side2))
	else:
		rectangles.append(Rectangle.ByWidthLength(side2,side1))
			
else:
	size2 = size*percent/100
	size1 = size-size2

	side11 = math.sqrt(size1)*rapport[0]
	side21 = size1/side11
	
	side12 = math.sqrt(size2)*rapport[1]
	side22 = size2/side12

	even1 = math.ceil(rapport[0]*100)%2
	even2 = math.ceil(rapport[1]*100)%2

	if even1 == 0:
		rectangles.append(Rectangle.ByWidthLength(side11,side21))
	else:
		rectangles.append(Rectangle.ByWidthLength(side21,side11))
		
	if even2 == 0:
		rectangles.append(Rectangle.ByWidthLength(side12,side22))
	else:
		rectangles.append(Rectangle.ByWidthLength(side12,side22))

OUT = rectangles
# ----------------------------------------
count_3 = List.Count(list=python_script_3)
randomNumbers_3 = Lists.Sequence.RandomNumbers(Min=number_2, Max=code_block_9, Number=count_3, Seed=material_position)
round_2 = Math.Round(number=randomNumbers_3)
byPatch_5 = Surface.ByPatch(closedCurve=python_script_3)
list_create_7 = List.Create(item0=byJoinedSurfaces_2, item1=filterByBoolMask_4.in)
flatten_3 = List.Flatten(list=list_create_7)
byJoinedSurfaces_4 = PolySurface.ByJoinedSurfaces(surfaces=flatten_3)
python_script_4 = Python(IN[0]=pointAtParameter_2, IN[1]=round_2, IN[2]=byPatch_5, IN[3]=byJoinedSurfaces_4)
# ---------- python_script_4.python (56 lines) ----------
# Load the Python Standard and DesignScript Libraries
import sys
import clr
clr.AddReference('ProtoGeometry')
from Autodesk.DesignScript.Geometry import *

# The inputs to this node will be stored as a list in the IN variables.
locations = IN[0]
index = IN[1]
geometry = IN[2]
existent = IN[3]

# Place your code below this line
x1 = 0
x2 = 0

bool1 = True
while bool1 == True:
	point1 = locations[int(index[0])]
	crane1 = Geometry.Translate(geometry[0],point1.X,point1.Y,point1.Z)
	bool1 = Geometry.DoesIntersect(crane1,existent)
	if index[0] == len(locations)-1:
		index[0]=0
	else:
		index[0]+=1
	x1+=1
	if x1 == len(locations):
		bool1 = False

if len(index)>1:
	bool2 = True
	boolex2 = True
	boolcr2 = True
	while bool2 == True:
		point2 = locations[int(index[1])]
		crane2 = Geometry.Translate(geometry[1],point2.X,point2.Y,point2.Z)
		boolex2 = Geometry.DoesIntersect(crane1,crane2)
		boolcr2 = Geometry.DoesIntersect(crane2,existent)
		if boolex2 == False and boolcr2 == False:
			bool2 = False
		if index[1] == len(locations)-1:
			index[1]=0
		else:
			index[1]+=1
		x2+=1
		if x2 == len(locations):
			bool1 = False

# Assign your output to the OUT variable.
if x1 == len(locations) or x2 == len(locations):
	OUT = None
else:
	if len(index) == 1:
		OUT = crane1,index[0]-1
	else:
		OUT = [[crane1,crane2],[index[0]-1,index[1]-1]]
# ----------------------------------------
firstItem_2 = List.FirstItem(list=python_script_4)
byJoinedSurfaces_5 = PolySurface.ByJoinedSurfaces(surfaces=firstItem_2)
doesIntersect_4 = Geometry.DoesIntersect(geometry=byJoinedSurfaces_5, other=filterByBoolMask_4.out, lacing=CrossProduct)
filterByBoolMask_5 = List.FilterByBoolMask(list=filterByBoolMask_4.out, mask=doesIntersect_4)
lastItem_2 = List.LastItem(list=python_script_4)

# group: Temporary facilities generation
code_block_11 = CodeBlock { 0.5; }
pointAtParameter_3 = Surface.PointAtParameter(surface=filterByBoolMask_5.out, u=code_block_11, v=code_block_11)
number_3 = DoubleInput(0)
count_4 = List.Count(list=pointAtParameter_3)
code_block_12 = CodeBlock(x=count_4) { x-1; }
number_4 = DoubleInput(1)
randomNumbers_4 = Lists.Sequence.RandomNumbers(Min=number_3, Max=code_block_12, Number=number_4, Seed=temporary_facilities_position)
round_3 = Math.Round(number=randomNumbers_4)
code_block_13 = CodeBlock { 0.5; 1; }
randomNumbers_5 = Lists.Sequence.RandomNumbers(Min=code_block_13.out0, Max=code_block_13.out1, Number=code_block_13.out1, Seed=temporary_facilities_shape)
python_script_5 = Python(IN[0]=code_block_7.TotalTemporaryFacilities, IN[1]=randomNumbers_5)
# ---------- python_script_5.python (32 lines) ----------
# Load the Python Standard and DesignScript Libraries
import sys
import clr
clr.AddReference('ProtoGeometry')
from Autodesk.DesignScript.Geometry import *
import math

# The inputs to this node will be stored as a list in the IN variables.
size = IN[0]
rapport = IN[1]

# Place your code below this line
size = size/len(rapport)

side1 = []
side2 = []
rectangles = []

for i in xrange(len(rapport)):
	side1.append(math.sqrt(size)*rapport[i])
	side2.append(size/side1[i])
	
even = math.ceil(rapport[0]*100)%2

if even == 0:
	for i in xrange(len(rapport)):
		rectangles.append(Rectangle.ByWidthLength(side1[i],side2[i]))
else:
	for i in xrange(len(rapport)):
		rectangles.append(Rectangle.ByWidthLength(side2[i],side1[i]))

OUT = rectangles
# ----------------------------------------
byPatch_6 = Surface.ByPatch(closedCurve=python_script_5)
list_create_8 = List.Create(item0=byJoinedSurfaces_4, item1=filterByBoolMask_5.in)
flatten_4 = List.Flatten(list=list_create_8)
byJoinedSurfaces_6 = PolySurface.ByJoinedSurfaces(surfaces=flatten_4)
python_script_6 = Python(IN[0]=pointAtParameter_3, IN[1]=round_3, IN[2]=byPatch_6, IN[3]=byJoinedSurfaces_6)  # same code as python_script_4
lastItem_3 = List.LastItem(list=python_script_6)
firstItem_3 = List.FirstItem(list=python_script_6)
byJoinedSurfaces_7 = PolySurface.ByJoinedSurfaces(surfaces=firstItem_3)
doesIntersect_5 = Geometry.DoesIntersect(geometry=byJoinedSurfaces_7, other=filterByBoolMask_5.out, lacing=CrossProduct)
filterByBoolMask_6 = List.FilterByBoolMask(list=filterByBoolMask_5.out, mask=doesIntersect_5)

# group: Crane visualization
getItemAtIndex_6 = List.GetItemAtIndex(list=pointAtParameter, index=lastItem)
code_block_14 = CodeBlock { 1000; }
byWidthLength_2 = Rectangle.ByWidthLength(width=code_block_14, length=code_block_14)
X_3 = Point.X(point=getItemAtIndex_6)
Y_3 = Point.Y(point=getItemAtIndex_6)
Z = Point.Z(point=getItemAtIndex_6)
translate = Geometry.Translate(geometry=byWidthLength_2, xTranslation=X_3, yTranslation=Y_3, zTranslation=Z)
byCenterPointRadius = Circle.ByCenterPointRadius(centerPoint=getItemAtIndex_6, radius=crane_size)

# group: Calculate Storage Distance
getItemAtIndex_7 = List.GetItemAtIndex(list=pointAtParameter_3, index=lastItem_3)
distanceTo = Geometry.DistanceTo(geometry=getItemAtIndex_7, other=getItemAtIndex_6, lacing=CrossProduct)
sum = Math.Sum(values=distanceTo)
sum_2 = Math.Sum(values=sum)
code_block_15 = CodeBlock(dist=sum_2, crNum=number_of_cranes) { dist/(crNum); }

# group: Distance of laydown to access compared to site size
getItemAtIndex_8 = List.GetItemAtIndex(list=pointAtParameter_2, index=lastItem_2)
distanceTo_2 = Geometry.DistanceTo(geometry=getItemAtIndex_8, other=remember_5, lacing=CrossProduct)
minimumItem = List.MinimumItem(list=distanceTo_2)
curves = PolyCurve.Curves(polyCurve=remember)
length = Curve.Length(curve=curves)
maximumItem = List.MaximumItem(list=length)
code_block_16 = CodeBlock(x=minimumItem, y=maximumItem) { x/y*100; }

# group: Laydown areas evenly distributed
firstItem_4 = List.FirstItem(list=firstItem_2)
lastItem_4 = List.LastItem(list=firstItem_2)
distanceTo_3 = Geometry.DistanceTo(geometry=firstItem_4, other=lastItem_4, lacing=CrossProduct)
code_block_17 = CodeBlock(x=distanceTo_3, y=maximumItem) { x/y*100; }

# group: Check presence of buffer zones
list_create_9 = List.Create(item0=remember_3, item1=remember_2)
removeNulls_2 = Lists.Manage.RemoveNulls(Data=list_create_9)
number_5 = DoubleInput(3000)
offset_2 = Curve.Offset(curve=removeNulls_2.Cleaned, distance=number_5)
byPatch_7 = Surface.ByPatch(closedCurve=offset_2)
byJoinedSurfaces_8 = PolySurface.ByJoinedSurfaces(surfaces=byPatch_7)
list_create_10 = List.Create(item0=filterByBoolMask_4.in, item1=filterByBoolMask_5.in, item2=filterByBoolMask_6.in)
flatten_5 = List.Flatten(list=list_create_10)
byJoinedSurfaces_9 = PolySurface.ByJoinedSurfaces(surfaces=flatten_5)
intersect = Geometry.Intersect(geometry=byJoinedSurfaces_8, other=byJoinedSurfaces_9)

# group: Site path generation
code_block_18 = CodeBlock { 0.5; }
pointAtParameter_4 = Surface.PointAtParameter(surface=filterByBoolMask_6.out, u=code_block_18, v=code_block_18)
number_6 = DoubleInput(0)
count_5 = List.Count(list=pointAtParameter_4)
code_block_19 = CodeBlock(x=count_5) { x-1; }
count_6 = List.Count(list=remember_5)
code_block_20 = CodeBlock(x=count_6) { 3-x; }
randomNumbers_6 = Lists.Sequence.RandomNumbers(Min=number_6, Max=code_block_19, Number=code_block_20, Seed=site_path_points)
round_4 = Math.Round(number=randomNumbers_6)
closestPointTo = Geometry.ClosestPointTo(geometry=remember, other=remember_5)
firstItem_5 = List.FirstItem(list=closestPointTo)
lastItem_5 = List.LastItem(list=closestPointTo)
python_script_7 = Python(IN[0]=pointAtParameter_4, IN[1]=round_4, IN[2]=firstItem_5, IN[3]=lastItem_5)
# ---------- python_script_7.python (56 lines) ----------
# Load the Python Standard and DesignScript Libraries
import sys
import clr
clr.AddReference('ProtoGeometry')
from Autodesk.DesignScript.Geometry import *

# The inputs to this node will be stored as a list in the IN variables.
locations = IN[0]
index = IN[1]
startPoint = IN[2]
endPoint = IN[3]
#existent = IN[4]

# Place your code below this line
#bool1 = True
#while bool1 == True:
#	bool = []
#	point1 = locations[int(index[0])]
#	for i in xrange(len(existent)):
#		bool.append(Polygon.ContainmentTest(existent[i],point1))
#	if any(x == True for x in bool) == False:
#		bool1 = False
#	if index[0] == len(locations)-1:
#		index[0]=0
#	else:
#		index[0]+=1

#bool2 = True
#while bool2 == True:
#	bool = []
#	point2 = locations[int(index[1])]
#	for i in xrange(len(existent)):
#		bool.append(Polygon.ContainmentTest(existent[i],point2))
#	if any(x == True for x in bool) == False:
#		bool2 = False
#	if index[1] == len(locations)-1:
#		index[1]=0
#	else:
#		index[1]+=1

# Assign your output to the OUT variable.
if len(index) == 2:
	point1 = locations[int(index[0])]
	point2 = locations[int(index[1])]
	list = [startPoint,point1,point2,endPoint]
	pol = Polygon.ByPoints(list)
	inter = Polygon.SelfIntersections(pol)

	if len(inter)==0:
		OUT = [[startPoint,point1,point2], [point1,point2,endPoint]]
	else:
		OUT = [[startPoint,point2,point1], [point2,point1,endPoint]]

else:
	point = locations[int(index[0])]
	OUT = [[startPoint,point], [point,endPoint]]
# ----------------------------------------
firstItem_6 = List.FirstItem(list=python_script_7)
lastItem_6 = List.LastItem(list=python_script_7)
surfaces = PolySurface.Surfaces(polySurface=byJoinedSurfaces_6)
list_create_11 = List.Create(item0=surfaces, item1=filterByBoolMask_6.in, item2=byPatch_7)
flatten_6 = List.Flatten(list=list_create_11)
thicken_2 = Surface.Thicken(surface=flatten_6)
byUnion = Solid.ByUnion(solids=thicken_2)
intersect_2 = Geometry.Intersect(geometry=byUnion, other=byPatch)
list_create_12 = List.Create(item0=byPatch, item1=intersect_2)
flatten_7 = List.Flatten(list=list_create_12)
perimeterCurves_2 = Surface.PerimeterCurves(surface=flatten_7)
endPoint = Curve.EndPoint(curve=perimeterCurves_2)
byPoints = Polygon.ByPoints(points=endPoint)
deconstruct = List.Deconstruct(list=byPoints)
shortestPath = Autodesk.RefineryToolkits.SpacePlanning.Analyze.PathFinding.ShortestPath(startPoint=firstItem_6, endPoint=lastItem_6, boundary=deconstruct.first, obstructions=deconstruct.rest)
flatten_8 = List.Flatten(list=shortestPath.path)

# group: Check mimimum path size
code_block_21 = CodeBlock { 3000; -3000; }
offset_3 = Curve.Offset(curve=flatten_8, distance=code_block_21.out0)
code_block_22 = CodeBlock { 0; 1; 0.2; }
range = Range(start=code_block_22.out0, end=code_block_22.out1, step=code_block_22.out2)
pointAtParameter_5 = Curve.PointAtParameter(curve=offset_3, param=range, lacing=CrossProduct)
offset_4 = Curve.Offset(curve=flatten_8, distance=code_block_21.out1)
pointAtParameter_6 = Curve.PointAtParameter(curve=offset_4, param=range, lacing=CrossProduct)
byStartPointEndPoint = Line.ByStartPointEndPoint(startPoint=pointAtParameter_5, endPoint=pointAtParameter_6)
extrude = Curve.Extrude(curve=byStartPointEndPoint)
list_create_13 = List.Create(item0=firstItem, item1=firstItem_2, item2=firstItem_3, item3=byPatch_2, item4=byPatch_3, item5=remember_7)
flatten_9 = List.Flatten(list=list_create_13)
removeNulls_3 = Lists.Manage.RemoveNulls(Data=flatten_9)
thicken_3 = Surface.Thicken(surface=removeNulls_3.Cleaned)
byUnion_2 = Solid.ByUnion(solids=thicken_3)
subtractFrom_2 = Surface.SubtractFrom(surface=extrude, trimmingEntity=byUnion_2)
flatten_10 = List.Flatten(list=subtractFrom_2)
perimeter = Surface.Perimeter(surface=flatten_10)
code_block_23 = CodeBlock(x=perimeter) { (x-2)/2; }
minimumItem_2 = List.MinimumItem(list=code_block_23)

# group: Solids for visualization
code_block_24 = CodeBlock(x=remember_4) { 1000; x*4000; }
extrudeAsSolid = Curve.ExtrudeAsSolid(curve=remember_2, distance=code_block_24.out1)
byUnion_3 = Solid.ByUnion(solids=extrudeAsSolid)
code_block_25 = CodeBlock { 15000; }
extrudeAsSolid_2 = Curve.ExtrudeAsSolid(curve=remember_3, distance=code_block_25)
byUnion_4 = Solid.ByUnion(solids=extrudeAsSolid_2)
perimeterCurves_3 = Surface.PerimeterCurves(surface=firstItem)
byJoinedCurves = PolyCurve.ByJoinedCurves(curves=perimeterCurves_3)
code_block_26 = CodeBlock { 2000; 50000; 1000; }
extrudeAsSolid_3 = Curve.ExtrudeAsSolid(curve=byJoinedCurves, distance=code_block_26.out0)
byUnion_5 = Solid.ByUnion(solids=extrudeAsSolid_3)
extrudeAsSolid_4 = Curve.ExtrudeAsSolid(curve=translate, distance=code_block_26.out1)
byUnion_6 = Solid.ByUnion(solids=extrudeAsSolid_4)
perimeterCurves_4 = Surface.PerimeterCurves(surface=firstItem_2)
byJoinedCurves_2 = PolyCurve.ByJoinedCurves(curves=perimeterCurves_4)
extrudeAsSolid_5 = Curve.ExtrudeAsSolid(curve=byJoinedCurves_2, distance=code_block_26.out2)
byUnion_7 = Solid.ByUnion(solids=extrudeAsSolid_5)
perimeterCurves_5 = Surface.PerimeterCurves(surface=firstItem_3)
byJoinedCurves_3 = PolyCurve.ByJoinedCurves(curves=perimeterCurves_5)
code_block_27 = CodeBlock(x=number_of_container_layers) { x*2500; }
extrudeAsSolid_6 = Curve.ExtrudeAsSolid(curve=byJoinedCurves_3, distance=code_block_27)
ZAxis = Vector.ZAxis()
byThickeningCurve = PolyCurve.ByThickeningCurve(curve=flatten_8, thickness=minimumItem_2, nor=ZAxis)
byPatch_8 = Surface.ByPatch(closedCurve=byThickeningCurve)
intersect_3 = Geometry.Intersect(geometry=byPatch_8, other=byPatch)
flatten_11 = List.Flatten(list=intersect_3)
thicken_4 = Surface.Thicken(surface=flatten_11, thickness=code_block_24.out0)
byUnion_8 = Solid.ByUnion(solids=thicken_4)

# group: Legend
workspace = ColorPalette({R: 233, G: 238, B: 255, A: 255})
building = ColorPalette({R: 79, G: 109, B: 172, A: 255})
obstacles = ColorPalette({R: 94, G: 94, B: 94, A: 255})
crane = ColorPalette({R: 94, G: 156, B: 168, A: 255})
material = ColorPalette({R: 199, G: 187, B: 168, A: 255})
facilities = ColorPalette({R: 166, G: 195, B: 223, A: 255})
site_path = ColorPalette({R: 164, G: 201, B: 201, A: 255})

# group: Assign colors
list_create_14 = List.Create(item0=byPatch, item1=byUnion_3, item2=byUnion_4, item3=byUnion_5, item4=byUnion_6, item5=byUnion_7, item6=extrudeAsSolid_6, item7=byUnion_8)
list_create_15 = List.Create(item0=workspace, item1=building, item2=obstacles, item3=crane, item4=crane, item5=material, item6=facilities, item7=site_path)
byGeometryColor = Modifiers.GeometryColor.ByGeometryColor(geometry=list_create_14, color=list_create_15)

# group: Optimization Output
perimeterCurves_6 = Surface.PerimeterCurves(surface=firstItem)
byJoinedCurves_4 = PolyCurve.ByJoinedCurves(curves=perimeterCurves_6)
perimeterCurves_7 = Surface.PerimeterCurves(surface=firstItem_2)
byJoinedCurves_5 = PolyCurve.ByJoinedCurves(curves=perimeterCurves_7)
perimeterCurves_8 = Surface.PerimeterCurves(surface=firstItem_3)
byJoinedCurves_6 = PolyCurve.ByJoinedCurves(curves=perimeterCurves_8)
byJoinedCurves_7 = PolyCurve.ByJoinedCurves(curves=flatten_8)
anonymous_stream = Sender(Equipment=byJoinedCurves_4, Material_Storage=byJoinedCurves_5, Temporary_Facilities=byJoinedCurves_6, Paths=byJoinedCurves_7, DocumentName="CANTIERE-optimizer2021", mySender="dVBNTwIxEN3F/fLjbEz0wMEjdncFFExIdMFE4sUImHgihZ0NDUO7absY/OletM1y4OIk8zrJvL55M47rOM6vCfvaOGsYyCYlLNcIQyGh1fwAqZjgg5T0SEKSVnNYoa4kDDhUWlJsNd+qBbLlK+ymYg18wCtE3wpeHeiQff1UsiEy4DowhOOZAvm8oQzDjCqYSYwmWgLdjHPvXSBENXWcn9TFdFeC67qe654fStdN+8G6txkcGbhE0+TfgiwAjVHOHldC22GE6cAzhOuV1qV6iOMctmQFSjNKVK1LvoRcq5iWLPCt0c8OjMRNlrz4P+Za/0y3O4dbihXM507U2J80CA1cdIu0vyhuaZrfpUXnvuj2210KSTuILGW043QjTv8A", RestApi="https://dev.hestia.speckle.works/api", Email="lorenzo.beltrani@hotmail.it", Server="Speckle Hestia Dev Server", StreamId="Y4eDo-B0H")

# group: Calculate covered footprint area
byPatch_9 = Surface.ByPatch(closedCurve=byCenterPointRadius)
intersect_4 = Geometry.Intersect(geometry=byPatch_9, other=byPatch_2)
flatten_12 = List.Flatten(list=intersect_4)
area_3 = Surface.Area(surface=flatten_12)
sum_3 = Math.Sum(values=area_3)

# group: Substract intersection
firstItem_7 = List.FirstItem(list=intersect_4)
byJoinedSurfaces_10 = PolySurface.ByJoinedSurfaces(surfaces=firstItem_7)
lastItem_7 = List.LastItem(list=intersect_4)
byJoinedSurfaces_11 = PolySurface.ByJoinedSurfaces(surfaces=lastItem_7)
intersect_5 = Geometry.Intersect(geometry=byJoinedSurfaces_10, other=byJoinedSurfaces_11)
area_4 = Surface.Area(surface=intersect_5)
sum_4 = Math.Sum(values=area_4)
sub_3 = sum_3 - sum_4

# group: Calculate % of Reached Area
code_block_28 = CodeBlock { 1; }
eq = number_of_cranes == code_block_28
if_ = If(test=eq, true=sum_3, false=sub_3)
isNull = Object.IsNull(obj=if_)
code_block_29 = CodeBlock { 0; }
if_2 = If(test=isNull, true=code_block_29, false=if_)
area_5 = Surface.Area(surface=byPatch_2)
div_3 = if_2 / area_5
code_block_30 = CodeBlock(x=div_3) { x*100; }

# group: % of laydown within crane radius
byJoinedSurfaces_12 = PolySurface.ByJoinedSurfaces(surfaces=byPatch_9)
firstItem_8 = List.FirstItem(list=firstItem_2)
intersect_6 = Geometry.Intersect(geometry=byJoinedSurfaces_12, other=firstItem_8)
area_6 = Surface.Area(surface=intersect_6)
python_script_8 = Python(IN[0]=area_6)
# ---------- python_script_8.python (16 lines) ----------
# Load the Python Standard and DesignScript Libraries
import sys
import clr
clr.AddReference('ProtoGeometry')
from Autodesk.DesignScript.Geometry import *

# The inputs to this node will be stored as a list in the IN variables.
list = IN[0]

# Place your code below this line
if len(list) == 0:
	OUT = 0
else:
	OUT = list

# Assign your output to the OUT variable.
# ----------------------------------------
firstItem_9 = List.FirstItem(list=python_script_8)
area_7 = Surface.Area(surface=firstItem_8)
code_block_31 = CodeBlock(x=firstItem_9, y=area_7) { x/y*100; }

# group: Travel distance facilities-workplace
byJoinedSurfaces_13 = PolySurface.ByJoinedSurfaces(surfaces=filterByBoolMask_6.out)
closestPointTo_2 = Geometry.ClosestPointTo(geometry=byJoinedSurfaces_13, other=getItemAtIndex_6)
getItemAtIndex_9 = List.GetItemAtIndex(list=pointAtParameter_3, index=lastItem_3)
closestPointTo_3 = Geometry.ClosestPointTo(geometry=byJoinedSurfaces_13, other=getItemAtIndex_9)
list_create_16 = List.Create(item0=byPatch_2, item1=byPatch_3, item2=firstItem, item3=firstItem_2, item4=firstItem_3)
flatten_13 = List.Flatten(list=list_create_16)
removeNulls_4 = Lists.Manage.RemoveNulls(Data=flatten_13)
perimeterCurves_9 = Surface.PerimeterCurves(surface=removeNulls_4.Cleaned)
endPoint_2 = Curve.EndPoint(curve=perimeterCurves_9)
byPoints_2 = Polygon.ByPoints(points=endPoint_2)
shortestPath_2 = Autodesk.RefineryToolkits.SpacePlanning.Analyze.PathFinding.ShortestPath(startPoint=closestPointTo_2, endPoint=closestPointTo_3, boundary=deconstruct.first, obstructions=byPoints_2)
curves_2 = PolyCurve.Curves(polyCurve=remember)
length_2 = Curve.Length(curve=curves_2)
sum_5 = Math.Sum(values=length_2)
code_block_32 = CodeBlock(x=shortestPath_2.length, y=sum_5) { x/(y/2)*100; }

# group: Check proximity to laydown
byJoinedSurfaces_14 = PolySurface.ByJoinedSurfaces(surfaces=filterByBoolMask_5.in)
distanceTo_4 = Geometry.DistanceTo(geometry=byJoinedSurfaces_14, other=flatten_8)
minimumItem_3 = List.MinimumItem(list=distanceTo_4)

# group: Check if it is within the crane radius
byJoinedSurfaces_15 = PolySurface.ByJoinedSurfaces(surfaces=byPatch_9)
doesIntersect_6 = Geometry.DoesIntersect(geometry=firstItem_3, other=byJoinedSurfaces_15)
allFalse = List.AllFalse(list=doesIntersect_6)

# group: Check if vehicles need manuvering
startPoint = Curve.StartPoint(curve=flatten_8)
endPoint_3 = Curve.EndPoint(curve=flatten_8)
python_script_9 = Python(IN[0]=startPoint, IN[1]=endPoint_3)
# ---------- python_script_9.python (24 lines) ----------
# Load the Python Standard and DesignScript Libraries
import sys
import clr
clr.AddReference('ProtoGeometry')
from Autodesk.DesignScript.Geometry import *

# The inputs to this node will be stored as a list in the IN variables.
start = IN[0]
end = IN[1]
angles = []

# Place your code below this line
for i in xrange(len(start)-1):
	#e1 = Curve.EndPoint(lines[i])
	#s1 = Curve.StartPoint(lines[i])
	#s2 = Curve.StartPoint(lines[i+1])
	#e2 = Curve.EndPoint(lines[i+1])
	v1 = Vector.ByTwoPoints(end[i],start[i])
	v2 = Vector.ByTwoPoints(start[i+1],end[i+1])
	angles.append(Vector.AngleWithVector(v1,v2))
#angles.append(Vector.AngleWithVector(Vector.ByTwoPoints(Curve.EndPoint(lines[i]),Curve.StartPoint(lines[i])),Vector.ByTwoPoints(Curve.StartPoint(lines[i+1]),Curve.EndPoint(lines[i+1]))))

# Assign your output to the OUT variable.
OUT = angles
# ----------------------------------------
code_block_33 = CodeBlock { 60; }
gt_2 = python_script_9 > code_block_33
allTrue = List.AllTrue(list=gt_2)

# group: Occupied area
area_8 = Surface.Area(surface=byJoinedSurfaces_9)
byJoinedSurfaces_16 = PolySurface.ByJoinedSurfaces(surfaces=filterByBoolMask_3.out)
area_9 = Surface.Area(surface=byJoinedSurfaces_16)
code_block_34 = CodeBlock(x=area_8, y=area_9) { x/y*100; }

# group: Ranking
of_covered_footprint = Remember(code_block_30)  # graph output
python_script_10 = Python(IN[0]=number_of_cranes, IN[1]=code_block_31, IN[2]=remember_5, IN[3]=code_block_32, IN[4]=minimumItem_3, IN[5]=crane_size, IN[6]=percentage_of_covered_area, IN[7]=allFalse, IN[8]=minimumItem_2, IN[9]=intersect, IN[10]=allTrue, IN[11]=code_block_34)
# ---------- python_script_10.python (126 lines) ----------
# Load the Python Standard and DesignScript Libraries
import sys
import clr
clr.AddReference('ProtoGeometry')
from Autodesk.DesignScript.Geometry import *

# The inputs to this node will be stored as a list in the IN variables.
nCranes = IN[0]
matINcrane = IN[1]
access = IN[2]
dWorkFacil = IN[3]
pathMatProx = IN[4]
craneSize = IN[5]
storageSize = IN[6]
facilOUTcrane = IN[7]
pathSize = IN[8]
distFromObj = IN[9]
manuver = IN[10]
busyArea = IN[11]

# Place your code below this line
nAccesses = len(access)
nIntersect = len(distFromObj)

TIMEscore = 0
COSTscore = 0
SAFETYscore = 0
QUALITYscore = 0

if nCranes == 2:
	TIMEscore+=1
elif nCranes == 1:
	COSTscore+=2

if matINcrane >= 80:
	TIMEscore+=3
	COSTscore+=3
	QUALITYscore+=1.5
	SAFETYscore+=0.5
	
if nAccesses == 2:
	TIMEscore+=1.5
	SAFETYscore+=1

if dWorkFacil <= 75 and dWorkFacil > 50:
	TIMEscore+=1
	COSTscore+=1
elif dWorkFacil <= 50 and dWorkFacil > 25:
	TIMEscore+=1.5
	COSTscore+=1.5
	QUALITYscore+=0.5
elif dWorkFacil <= 25:
	TIMEscore+=2
	COSTscore+=2
	QUALITYscore+=1
	
if pathMatProx != None and pathMatProx <= 4000:
	TIMEscore+=2.5
	
if craneSize == 50000:
	COSTscore+=0
elif craneSize == 40000:
	COSTscore+=0.5
elif craneSize == 30000:
	COSTscore+=1
elif craneSize == 20000:
	COSTscore+=1.5

if storageSize == 50:
	QUALITYscore+=1.5
elif storageSize == 40:
	QUALITYscore+=1
elif storageSize == 30:
	COSTscore+=0.5
	QUALITYscore+=0.5
elif storageSize == 20:
	COSTscore+=1
elif storageSize < 20:
	COSTscore+1.5

if facilOUTcrane == True:
	SAFETYscore+=2.5

if pathSize >= 3000 and pathSize < 4000:
	SAFETYscore+=0.25
elif pathSize >= 4000 and pathSize < 5000:
	SAFETYscore+=0.5
elif pathSize >= 6000 and pathSize < 6000:
	SAFETYscore+=0.75
elif pathSize > 6000:
	SAFETYscore+=1

if nIntersect == 0:
	SAFETYscore+=2.5
	QUALITYscore+=2.5
elif nIntersect == 1:
	SAFETYscore+=1.5
	QUALITYscore+=1.5
elif nIntersect == 2:
	SAFETYscore+=0.5
	QUALITYscore+=0.5

if manuver == True:
	SAFETYscore+=1
	QUALITYscore+=1

if busyArea < 10:
	SAFETYscore+=1.5
	QUALITYscore+=2.5
elif busyArea >= 10 and busyArea < 20:
	SAFETYscore+=1.25
	QUALITYscore+=2
elif busyArea >= 20 and busyArea < 30:
	SAFETYscore+=1
	QUALITYscore+=1.5
elif busyArea >= 30 and busyArea < 40:
	SAFETYscore+=0.75
	QUALITYscore+=1
elif busyArea >= 40 and busyArea < 50:
	QUALITYscore+=0.5
	SAFETYscore+=0.5

OVERALLscore = (TIMEscore + COSTscore + SAFETYscore + QUALITYscore)/4

# Assign your output to the OUT variable.
OUT = [TIMEscore,COSTscore,SAFETYscore,QUALITYscore,OVERALLscore]
# ----------------------------------------
firstItem_10 = List.FirstItem(list=python_script_10)
time_score = Remember(firstItem_10)  # graph output
code_block_35 = CodeBlock { 1; 2; 3; }
getItemAtIndex_10 = List.GetItemAtIndex(list=python_script_10, index=code_block_35.out0)
cost_score = Remember(getItemAtIndex_10)  # graph output
getItemAtIndex_11 = List.GetItemAtIndex(list=python_script_10, index=code_block_35.out1)
safety_score = Remember(getItemAtIndex_11)  # graph output
getItemAtIndex_12 = List.GetItemAtIndex(list=python_script_10, index=code_block_35.out2)
quality_score = Remember(getItemAtIndex_12)  # graph output
lastItem_8 = List.LastItem(list=python_script_10)
overall_score = Remember(lastItem_8)  # graph output
