# Dynamo graph Revit IS.dyn (Dynamo 2.5.0.7460)
# packages: Speckle for Dynamo 1.7.0

# group: Revit IS
# note: ADDITIONAL COMMENTS
# N/A
# note: REQUIRED DYNAMO PACKAGES
# Speckle for Dynamo (version 1.7.0)
# note: DYNAMO VERSION
# 2.5.2
# note: DYNAMO PROJECT
# Revit IS.dyn
# note: ASSOCIATED FILE(S)
# CANTIERE optimizer.dyn
# note: AUTHOR(S) / CREATION DATE
# Lorenzo Beltrani / July 2020
# note: DESCRIPTION
# This graph transforms the elements selected in the Revit model into inputs for the main script (assiociated file).

# group: Inputs
# note: Working / Function
# Orange indicates the working of the script. No changes should be made in these groups unless advised.
select_building = DSModelElementsSelection()  # 1156 picked in the model; graph input
# note: Inputs
# Blue indicates Inputs that must be set accordingly before running the script.
select_topography = DSModelElementSelection()  # 1 picked in the model; graph input
# note: Output
# Green indicates the output that is sent to the main script.
select_obstacles = DSModelElementSelection()  # 1 picked in the model
define_2nd_site_access_optional = DSPointOnElementSelection()  # 1 picked in the model
define_site_access = DSPointOnElementSelection()  # 1 picked in the model; graph input

# group: Import the building geometry
geometry = Element.Geometry(element=select_building)
flatten = List.Flatten(list=geometry)
explode = Geometry.Explode(geometry=flatten)

# group: Filter surfaces parallel to XY
normalAtParameter = Surface.NormalAtParameter(surface=explode)
ZAxis = Vector.ZAxis()
isAlmostEqualTo = Vector.IsAlmostEqualTo(vector=normalAtParameter, other=ZAxis)
filterByBoolMask = List.FilterByBoolMask(list=explode, mask=isAlmostEqualTo)
flatten_2 = List.Flatten(list=filterByBoolMask.in)

# group: Import the topography
geometry_2 = Element.Geometry(element=select_topography)
vertexPositions = Mesh.VertexPositions(mesh=geometry_2)
flatten_3 = List.Flatten(list=vertexPositions)

# group: Flatten topography to reference plane
Z = Point.Z(point=flatten_3)
round = Math.Round(number=Z)
firstItem = List.FirstItem(list=round)
setDifference = List.SetDifference(list1=round, list2=firstItem)
isEmpty = List.IsEmpty(list=setDifference)
XY = Plane.XY()
project = Point.Project(point=flatten_3, baseGeometry=XY, projectionDirection=ZAxis)
flatten_4 = List.Flatten(list=project)
if_ = If(test=isEmpty, true=flatten_3, false=flatten_4)

boolean = BoolSelector(false)

# group: Move geometry to reference plane
code_block = CodeBlock { 0; }
if_2 = If(test=isEmpty, true=firstItem, false=code_block)
perimeterCurves = Surface.PerimeterCurves(surface=flatten_2)
endPoint = Curve.EndPoint(curve=perimeterCurves)
Z_2 = Point.Z(point=endPoint)
firstItem_2 = List.FirstItem(list=Z_2@L2)
sub = if_2 - firstItem_2
byCoordinates = Vector.ByCoordinates(z=sub)
translate = Geometry.Translate(geometry=flatten_2, direction=byCoordinates)
maximumItem = List.MaximumItem(list=firstItem_2)
thicken = Surface.Thicken(surface=translate, thickness=maximumItem, both_sides=boolean)

# group: Divide footprint and construction site
byUnion = Solid.ByUnion(solids=thicken)
byPerimeterPoints = Surface.ByPerimeterPoints(points=if_)
intersect = Geometry.Intersect(geometry=byUnion, other=byPerimeterPoints)

# group: Import site objects
geometry_3 = Element.Geometry(element=select_obstacles)
byGeometry = BoundingBox.ByGeometry(geom=geometry_3)
minPoint = BoundingBox.MinPoint(boundingBox=byGeometry)
maxPoint = BoundingBox.MaxPoint(boundingBox=byGeometry)
byCorners = Cuboid.ByCorners(lowPoint=minPoint, highPoint=maxPoint)
explode_2 = Geometry.Explode(geometry=byCorners)

# group: Filter surfaces parallel to XY
normalAtParameter_2 = Surface.NormalAtParameter(surface=explode_2)
ZAxis_2 = Vector.ZAxis()
isAlmostEqualTo_2 = Vector.IsAlmostEqualTo(vector=normalAtParameter_2, other=ZAxis_2)
filterByBoolMask_2 = List.FilterByBoolMask(list=explode_2, mask=isAlmostEqualTo_2)
flatten_5 = List.Flatten(list=filterByBoolMask_2.in)

# group: Move geometry to surface
perimeterCurves_2 = Surface.PerimeterCurves(surface=flatten_5)
ZAxis_3 = Vector.ZAxis()
projectInputOnto = Surface.ProjectInputOnto(surface=byPerimeterPoints, geometryToProject=perimeterCurves_2, projectionDirection=ZAxis_3)

# group: Specify access to site
byPoints = Polygon.ByPoints(points=if_)
list_create = List.Create(item0=define_2nd_site_access_optional, item1=define_site_access)
clean = List.Clean(list=list_create@L1)
flatten_6 = List.Flatten(list=clean)
closestPointTo = Geometry.ClosestPointTo(geometry=byPoints, other=flatten_6)

# group: Levels
code_block_2 = CodeBlock { 0.5; }
pointAtParameter = Surface.PointAtParameter(surface=flatten_2, u=code_block_2, v=code_block_2)
Z_3 = Point.Z(point=pointAtParameter)
round_2 = Math.Round(number=Z_3)
uniqueItems = List.UniqueItems(list=round_2)
sort = List.Sort(list=uniqueItems)
python_script = Python(IN[0]=sort)
# ---------- python_script.python (19 lines) ----------
# Load the Python Standard and DesignScript Libraries
import sys
import clr
clr.AddReference('ProtoGeometry')
from Autodesk.DesignScript.Geometry import *

# The inputs to this node will be stored as a list in the IN variables.
list = IN[0]

# Place your code below this line
levels = 0

for i in xrange (len(list)-1):
	diff = list[i+1] - list[i]
	if diff > 1500:
		levels+=1

# Assign your output to the OUT variable.
OUT = levels
# ----------------------------------------

# group: Output
perimeterCurves_3 = Surface.PerimeterCurves(surface=intersect)
byJoinedCurves = PolyCurve.ByJoinedCurves(curves=perimeterCurves_3)
perimeterCurves_4 = Surface.PerimeterCurves(surface=byPerimeterPoints)
byJoinedCurves_2 = PolyCurve.ByJoinedCurves(curves=perimeterCurves_4)
flatten_7 = List.Flatten(list=projectInputOnto@L3)
byJoinedCurves_3 = PolyCurve.ByJoinedCurves(curves=flatten_7)
revit_is = Sender(Building_Footprint=byJoinedCurves, Workspace=byJoinedCurves_2, Site_Objects=byJoinedCurves_3, Access_to_Site=closestPointTo, Number_of_Storeys=python_script, DocumentName="Revit IS", mySender="dVBNS8NAEE1qmsaPswh66MFj2X7FNAgFbVQoHhTbireybQayZLob9qNaf7oX3SU99OLAvB2Yt2/ejOd7nvdrw70uzhoWJrMK1iVCJiR02u8gFRN83Ccp6ZFep50Z1EbCmIPRkmKn/WpWyNbPsJuLEviYG8SmE7w60CH7+r5iGTLgOrSE44UC+bihDFsTqmAhMZppCXQzzYM3gRDV1Gl+UhfzXQW+7we+f34oXTfdB+feZXhk4RJtk38LsgK0Rjm7K4R2wwjTYWAJ14XWlbrtdnPYkgKUZpSoWpd8ClmqLq1Y2HRGn9RX/FEK89L8sdf6Z7rbubWlaGC59KLG/qRhy8LFDaSDQQoQpzTvr0bJKE6G8TBZh5GjPOw43YjTPw==", RestApi="https://dev.hestia.speckle.works/api", Email="lorenzo.beltrani@hotmail.it", Server="Speckle Hestia Dev Server", StreamId="Fsx4XkouO")
