# Dynamo graph SketchUp IS.dyn (Dynamo 2.5.0.7460)
# packages: SketchUpForDynamo 1.5.4, Speckle for Dynamo 1.7.0

# group: SketchUp IS
# note: AUTHOR(S) / CREATION DATE
# Lorenzo Beltrani / July 2020
# note: DESCRIPTION
# This graph transforms the geometry of a SketchUp model into inputs for the main script (assiociated file).
# note: ADDITIONAL COMMENTS
# N/A
# note: REQUIRED DYNAMO PACKAGES
# SketchUpForDynamo (version 1.5.4)
# Speckle for Dynamo (version 1.7.0)
# note: ASSOCIATED FILE(S)
# CANTIERE optimizer.dyn
# note: DYNAMO PROJECT
# SketchUp IS.dyn
# note: DYNAMO VERSION
# 2.5.2

# group: Inputs
# note: Inputs
# Blue indicates Inputs that must be set accordingly before running the script.
file_path = Filename("No file selected.")
# note: Output
# Green indicates the output that is sent to the main script.
# note: Working / Function
# Orange indicates the working of the script. No changes should be made in these groups unless advised.
number_of_storeys = DoubleInput(4)

# group: Working / function
loadModel = SketchUpForDynamo.SketchUp.LoadModel(path=file_path)
code_block = CodeBlock { 1000; }
scale = Geometry.Scale(geometry=loadModel.Surfaces, amount=code_block)
deconstruct = List.Deconstruct(list=scale)
deconstruct_2 = List.Deconstruct(list=deconstruct.rest)
perimeterCurves = Surface.PerimeterCurves(surface=deconstruct_2.first)
byJoinedCurves = PolyCurve.ByJoinedCurves(curves=perimeterCurves)
byJoinedSurfaces = PolySurface.ByJoinedSurfaces(surfaces=scale)
perimeterCurves_2 = Surface.PerimeterCurves(surface=byJoinedSurfaces)
byJoinedCurves_2 = PolyCurve.ByJoinedCurves(curves=perimeterCurves_2)
perimeterCurves_3 = Surface.PerimeterCurves(surface=deconstruct_2.rest)
byJoinedCurves_3 = PolyCurve.ByJoinedCurves(curves=perimeterCurves_3)
scale_2 = Geometry.Scale(geometry=loadModel.Edges, amount=code_block)
count = List.Count(list=scale_2)
code_block_2 = CodeBlock(x=count) { x-3; }
getItemAtIndex = List.GetItemAtIndex(list=scale_2, index=code_block_2)
lastItem = List.LastItem(list=scale_2)
list_create = List.Create(item0=getItemAtIndex, item1=lastItem)
startPoint = Curve.StartPoint(curve=list_create)
endPoint = Curve.EndPoint(curve=list_create)
list_create_2 = List.Create(item0=startPoint, item1=endPoint)
flatten = List.Flatten(list=list_create_2)
doesIntersect = Geometry.DoesIntersect(geometry=byJoinedCurves_2, other=flatten)
filterByBoolMask = List.FilterByBoolMask(list=flatten, mask=doesIntersect)
round = Math.Round(number=number_of_storeys)

# group: Output
sketchup_is = Sender(Building_Footprint=byJoinedCurves, Workspace=byJoinedCurves_2, Site_Objects=byJoinedCurves_3, Access_to_Site=filterByBoolMask.in, Number_of_Storeys=round, DocumentName="SketchUp IS", mySender="dVBNS8NAEE1qm8SPswh6yMFj3DaUoggFTRQsXsS2gl7KJjvSpdPdsLuJxJ/uRXdJD704MG8H5u2bN+P5nuf92nCvi5OehWxeQblByKWCJH4DpbkU05TckBEZJXFeo6kVTAXURlFM4pe6QF4+Q7uQGxBTUSMOnODFng7Z1fcVz5GDMIElHC41qMct5RhmVMNSYTQ3Cuh2xvqvEiHqqDN21BWLtgLf9/u+f7ov3TXdB+feZXBg4RxtU3xLUgBao4LfraVxwwg3Qd8SLtfGVPp2OGTQkDVowynRnS75kmqjh7TiwcAZTZv3q4wvnj4GP/Za/0x3O4cNxRpWKy/q7U4ahBbOJgAFZen1+DNlMB5NaFmyIgUWRI7y0Aq6lcd/", RestApi="https://dev.hestia.speckle.works/api", Email="lorenzo.beltrani@hotmail.it", Server="Speckle Hestia Dev Server", StreamId="1vY-BiTHZ")
